# Dynamo graph joinBB.dyn (Dynamo 1.3.3.4111)

categories = Categories("Walls")
all_elements_of_category = ElementsOfCategory(categories)
categories_2 = Categories("Floors")
all_elements_of_category_2 = ElementsOfCategory(categories_2)
intersectBB = Python(IN[0]=all_elements_of_category, IN[1]=all_elements_of_category_2)
# ---------- intersectBB.python (30 lines) ----------
import clr

clr.AddReference("RevitAPI")
from Autodesk.Revit.DB import *

def overlap1D(a1, a2, b1, b2):
  if a2>=b1 and b2>=a1:
    return True
  return False
  
def bbIntersect(bbA, bbB):
  return overlap1D(bbA.Min.X,bbA.Max.X,bbB.Min.X,bbB.Max.X) and overlap1D(bbA.Min.Y,bbA.Max.Y,bbB.Min.Y,bbB.Max.Y) and overlap1D(bbA.Min.Z,bbA.Max.Z,bbB.Min.Z,bbB.Max.Z)

#The inputs to this node will be stored as a list in the IN variables.
listA = UnwrapElement(IN[0])
listB = UnwrapElement(IN[1])

output = []

for a in listA:
  bbA = a.get_BoundingBox(None)
  if not bbA is None:
    for b in listB:
      bbB = b.get_BoundingBox(None)
      if not bbB is None:
        if bbIntersect(bbA,bbB):
          output.append([a,b])

#Assign your output to the OUT variable.
OUT = output
# ----------------------------------------
transpose = List.Transpose(intersectBB)
code_block = CodeBlock(x=transpose) { x[0]; }
geometry = Element.Geometry(code_block)
code_block_2 = CodeBlock(x=transpose) { x[1]; }
geometry_2 = Element.Geometry(code_block_2)
doesIntersect = Geometry.DoesIntersect(geometry=geometry, other=geometry_2)
code_block_3 = CodeBlock { 1; }
flatten = List.Flatten(list=doesIntersect, amt=code_block_3)
filterByBoolMask = List.FilterByBoolMask(list=code_block, mask=flatten)
filterByBoolMask_2 = List.FilterByBoolMask(list=code_block_2, mask=flatten)
join = Python(IN[0]=filterByBoolMask.in, IN[1]=filterByBoolMask_2.in)
# ---------- join.python (29 lines) ----------
import clr
clr.AddReference("RevitAPI")
from Autodesk.Revit.DB import *

clr.AddReference("RevitServices")
import RevitServices
from RevitServices.Persistence import DocumentManager
from RevitServices.Transactions import TransactionManager
#The inputs to this node will be stored as a list in the IN variables.
list_a = UnwrapElement(IN[0])
list_b = UnwrapElement(IN[1])

doc = DocumentManager.Instance.CurrentDBDocument
TransactionManager.Instance.EnsureInTransaction(doc)

output = []

for a,b in zip(list_a,list_b):
	try:
		JoinGeometryUtils.JoinGeometry(doc,a,b)
		output.append("OK")
	except Exception,e:
		output.append(str(e))


TransactionManager.Instance.TransactionTaskDone()

#Assign your output to the OUT variable.
OUT = output
# ----------------------------------------
